# Grasshopper definition 6.4 改进版编织纹理.gh (Grasshopper 1.0.7)

参考曲面 = Surface(<surface referenced from the Rhino model>)
y方向像素数量 = Number(Slider(160, range=0..1000))
x方向单元数量 = Number(Slider(16, range=0..100))
x方向像素数量 = Number(Slider(150, range=0..1000))
y方向单元数量 = Number(Slider(16, range=0..100))
y方向重复次数 = Number(Slider(2, range=0..10))
半径 = Number(Slider(22, range=0..100))
x方向重复次数 = Number(Slider(2, range=0..10))
参考曲面_2 = Surface(参考曲面)
起伏 = Number(Slider(25, range=0..100))
number = Number(Toggle(True))
multiplication = Multiplication(A=x方向重复次数, B=x方向单元数量)
multiplication_2 = Multiplication(A=y方向重复次数, B=y方向单元数量)

# ---- group: 获取采样点
division = Division(A=x方向像素数量, B=x方向单元数量)
division_2 = Division(A=y方向像素数量, B=y方向单元数量)
round = Round(Number=division)  # -> Nearest, Floor, Ceiling
round_2 = Round(Number=division_2)  # -> Nearest, Floor, Ceiling
multiplication_3 = Multiplication(A=round_2.Nearest, B=0.5)
multiplication_4 = Multiplication(A=round.Nearest, B=0.5)
subtraction = Subtraction(A=x方向像素数量, B=multiplication_4)
subtraction_2 = Subtraction(A=y方向像素数量, B=multiplication_3)
dom = ConstructDomain(DomainStart=multiplication_4, DomainEnd=subtraction)
dom_2 = ConstructDomain(DomainStart=multiplication_3, DomainEnd=subtraction_2)
range = Range(Domain=dom, Steps=expr("x-1", x方向单元数量))
range_2 = Range(Domain=dom_2, Steps=expr("x-1", y方向单元数量))
pt = ConstructPoint(XCoordinate=range, YCoordinate=graft(range_2), ZCoordinate=0)  # -> simplify(Point)

# ----
divide = DivideDomain²(Domain=参考曲面_2, UCount=1, VCount=multiplication_2)
subsrf = Isotrim(Surface=参考曲面_2, Domain=divide)  # -> simplify(graft(Surface))
divide_2 = DivideDomain²(Domain=subsrf, UCount=multiplication, VCount=1)
subsrf_2 = Isotrim(Surface=subsrf, Domain=divide_2)  # -> simplify(Surface)
area = Area(Geometry=subsrf_2, UseTasks=True)  # -> Area, simplify(Centroid)
image = ImageSampler(pt, FilePath="E:\Desktop\HOW.jpg", Filter="Value", Interpolate=False, Umax=150, Umin=1, Vmax=160, Vmin=1, Wrap=0)
srf_cp = SurfaceClosestPoint(Point=area.Centroid, Surface=subsrf_2)  # -> Point, UVPoint, Distance
evalsrf = EvaluateSurface(Surface=subsrf, Point=srf_cp.UVPoint)  # -> Point, Normal, UDirection, VDirection, Frame
计算位移数值 = CSharpScript(x=image, y=起伏)  # -> A; inputs x: Double, y: Double
# ---------- 计算位移数值: C# ----------
    double round = Math.Round(x, 0);
    A = (round + round - 1) * y;
# ---------- end 计算位移数值 ----------
dup = DuplicateData(Data=计算位移数值, Number=x方向重复次数, Order=True)  # -> simplify(Data)
flip = FlipMatrix(Data=dup)
dup_2 = DuplicateData(Data=flip, Number=y方向重复次数, Order=True)  # -> simplify(Data)
flip_2 = FlipMatrix(Data=dup_2)
amp = Amplitude(Vector=evalsrf.Normal, Amplitude=flip_2)
move = Move(Geometry=evalsrf.Point, Motion=expr("-x", amp))  # -> Geometry, Transform
move_2 = Move(Geometry=evalsrf.Point, Motion=amp)  # -> Geometry, Transform
flip_3 = FlipMatrix(Data=move.Geometry)
intcrv = Interpolate(Vertices=move_2.Geometry, Degree=3, Periodic=False, KnotStyle=1)  # -> Curve, Length, Domain
intcrv_2 = Interpolate(Vertices=flip_3, Degree=3, Periodic=False, KnotStyle=1)  # -> Curve, Length, Domain
c_script = CSharpScript(crv=intcrv.Curve, r=半径)  # -> A; inputs crv: Curve, r: Double
# ---------- c_script: C# ----------
    A = Mesh.CreateFromCurvePipe(crv, r, 6, 1, MeshPipeCapStyle.Flat, false, null);
# ---------- end c_script ----------
c_script_2 = CSharpScript(crv=intcrv_2.Curve, r=半径)  # -> A; inputs crv: Curve, r: Double; same code as c_script
smooth = CSharpScript(G=c_script_2, y=number)  # -> A; inputs G: Mesh, y: Boolean
# ---------- smooth: C# ----------
    if(y)
    {A = SubD.CreateFromMesh(G);}
    else
    {A = G;}
# ---------- end smooth ----------
smooth_2 = CSharpScript(G=c_script, y=number)  # -> A; inputs G: Mesh, y: Boolean; same code as smooth
preview = CustomPreview(Geometry=smooth, Material=ColourSwatch(SwatchColor=RGB(115, 114, 116)))
preview_2 = CustomPreview(Geometry=smooth_2, Material=ColourSwatch(SwatchColor=RGB(217, 148, 77)))
