# Grasshopper definition MeshFromPolylines.gh (Grasshopper 1.0.7)
# plug-ins: Kangaroo2 Components

crv = Curve([<curve referenced from the Rhino model> x4])
pl2m = Pl2M(crv=crv)
mesh = Mesh(pl2m)
medges = MeshEdges(Mesh=mesh)  # -> NakedEdges, InteriorEdges, NonManifoldEdges
mp = MultiPipe(
    Curves=[medges.NakedEdges, medges.InteriorEdges],
    NodeSize=Slider(3, range=0..10),
    EndOffset=1,
    StrutSize=1,
    Segment=0,
    KinkAngle=0.6,
    CubeFit=0,
    Caps=0)
subd = SubD(mp)

# ==== cluster Pl2M
crv = ClusterInput()
crv_2 = Curve(crv)
cpoly = ControlPolygon(Curve=crv_2)  # -> Polygon, Points
pdecon = Deconstruct(Point=cpoly.Points)  # -> XComponent, YComponent, ZComponent
pt = ConstructPoint(XCoordinate=pdecon.XComponent, YCoordinate=pdecon.YComponent, ZCoordinate=0)
pline = PolyLine(Vertices=pt, Closed=True)  # -> flatten(Polyline)
centroid = Centroid(crv=pline)  # -> Area; inputs crv: Curve
# ---------- centroid: C# ----------
    AreaMassProperties amp = AreaMassProperties.Compute(crv);
    Area = amp.Area;
# ---------- end centroid ----------
sort = SortList(Keys=centroid, ValuesA=crv_2)  # -> Keys, reverse(ValuesA)
split = SplitList(List=sort.ValuesA, Index=1)  # -> ListA, ListB
内轮廓 = Curve(split.ListB)
外轮廓 = Curve(split.ListA)
cpoly_2 = ControlPolygon(Curve=外轮廓)  # -> Polygon, Points
cpoly_3 = ControlPolygon(Curve=内轮廓)  # -> Polygon, Points
cull_i = CullIndex(List=cpoly_2.Points, Indices=0, Wrap=True)
cull_i_2 = CullIndex(List=cpoly_3.Points, Indices=0, Wrap=True)
del = DelaunayMesh(Points=flatten([cull_i, cull_i_2]), Plane=PlaneXY(0, 0, 0))
facen = FaceNormals(Mesh=del)  # -> Centers, Normals
incurves = PointInCurves(Point=facen.Centers, Curves=内轮廓)  # -> Relationship, Index, Point
cullf = CullFaces(Mesh=del, Pattern=incurves.Relationship)
mesh = ClusterOutput(cullf)
