# Grasshopper definition 六角竹编(7.3).gh (Grasshopper 1.0.7)

六角竹编 = 六角竹编()

# ==== cluster 六角竹编: 无论什么曲面类型拖进去就能生成美观的六角竹编纹样
geometry = ClusterInput()
length = ClusterInput()
triremesh = TriRemesh(Geometry=geometry, Sharp=True, Length=length, Iterations=25)  # -> Triangulation, Dual, Creases
distance = ClusterInput()

# ---- group: 分解mesh,再分解面提取face中的顶点序号
demesh = DeconstructMesh(Mesh=triremesh.Triangulation)  # -> Vertices, Faces, Colours, Normals
deface = DeconstructFace(Face=demesh.Faces)  # -> CornerA, CornerB, CornerC, CornerD

# ----
offsetmesh = GhPythonScript(mesh=triremesh.Triangulation, distance=distance)  # -> a, geo; inputs mesh: Mesh
# ---------- offsetmesh: Python ----------
__author__ = "P51"
__version__ = "2021.05.16"

import rhinoscriptsyntax as rs
geo = mesh.Offset(distance,False)
# ---------- end offsetmesh ----------
demesh_2 = DeconstructMesh(Mesh=offsetmesh.geo)  # -> Vertices, Faces, Colours, Normals
deface_2 = DeconstructFace(Face=demesh_2.Faces)  # -> CornerA, CornerB, CornerC, CornerD

# ---- group: 提取顶点
item = ListItem(List=demesh.Vertices, Index=deface.CornerA, Wrap=True)
item_2 = ListItem(List=demesh.Vertices, Index=deface.CornerB, Wrap=True)
item_3 = ListItem(List=demesh.Vertices, Index=deface.CornerC, Wrap=True)

# ----
item_4 = ListItem(List=demesh_2.Vertices, Index=deface_2.CornerA, Wrap=True)
item_5 = ListItem(List=demesh_2.Vertices, Index=deface_2.CornerB, Wrap=True)
item_6 = ListItem(List=demesh_2.Vertices, Index=deface_2.CornerC, Wrap=True)
num = ClusterInput()
ln = Line(StartPoint=item_4, EndPoint=item_5)
ln_2 = Line(StartPoint=item_6, EndPoint=item_4)
ln_3 = Line(StartPoint=item_5, EndPoint=item_6)

# ---- group: 画线
ln_4 = Line(StartPoint=item, EndPoint=item_2)
ln_5 = Line(StartPoint=item_3, EndPoint=item)
ln_6 = Line(StartPoint=item_2, EndPoint=item_3)

# ----
num_2 = Number(num)
weave = Weave(Pattern=[0, 1, 2], Stream0=graft(ln), Stream1=graft(ln_2), Stream2=graft(ln_3), NullGaps=False)
weave_2 = Weave(Pattern=[0, 1, 2], Stream0=graft(ln_4), Stream1=graft(ln_5), Stream2=graft(ln_6), NullGaps=False)

# ---- group: 做中点辅助
number_slider = Slider(0.5, range=0..1)
eval = EvaluateCurve(Curve=reparameterize(weave_2), Parameter=number_slider)  # -> Point, Tangent, Angle

# ----
eval_2 = EvaluateCurve(Curve=reparameterize(weave), Parameter=number_slider)  # -> Point, Tangent, Angle
amp = Amplitude(Vector=eval.Tangent, Amplitude=num_2)  # -> simplify(Vector)
amp_2 = Amplitude(Vector=eval_2.Tangent, Amplitude=num_2)  # -> simplify(Vector)
number_slider_2 = Slider(1, range=0..10)

# ---- group: 生成侧面点
move = Move(Geometry=eval.Point, Motion=expr("-x", amp))  # -> simplify(Geometry), Transform
move_2 = Move(Geometry=eval_2.Point, Motion=amp_2)  # -> simplify(Geometry), Transform
move_3 = Move(Geometry=eval.Point, Motion=amp)  # -> simplify(Geometry), Transform
move_4 = Move(Geometry=eval_2.Point, Motion=expr("-x", amp_2))  # -> simplify(Geometry), Transform

# ----
shift = ShiftList(List=move_2.Geometry, Shift=number_slider_2, Wrap=True)  # -> simplify(List)
shift_2 = ShiftList(List=move_4.Geometry, Shift=number_slider_2, Wrap=True)  # -> simplify(List)
weave_3 = Weave(
    Pattern=[0, 1, 2, 3],
    Stream0=graft(move_3.Geometry),
    Stream1=graft(move.Geometry),
    Stream2=graft(shift),
    Stream3=graft(shift_2),
    NullGaps=False)

# ---- group: 生成mesh
conmesh = ConstructMesh(Vertices=weave_3, Faces={A=0, B=1, C=2, D=3})

# ----
mjoin = MeshJoin(Meshes=flatten(conmesh))
distance_2 = ClusterInput()
meshthicken = GhPythonScript(mesh=mjoin, distance=distance_2)  # -> a, geo; inputs mesh: Mesh
# ---------- meshthicken: Python ----------
__author__ = "P51"
__version__ = "2021.05.16"

import rhinoscriptsyntax as rs
geo = mesh.Offset(distance,True)
# ---------- end meshthicken ----------
subdmesh = SubDFromMesh(Mesh=meshthicken.geo, Creases=1, Corners=1, Interpolate=False)
S = ClusterOutput(subdmesh)
