# Grasshopper definition 六角竹编（5）.gh (Grasshopper 1.0.7)

六角竹编 = 六角竹编简易版(U=10, V=10, 竹篾垂直间距=5, 竹篾厚度=5)

# ==== cluster 六角竹编简易版
srf = ClusterInput()
U = ClusterInput()
V = ClusterInput()
trib = TrianglePanelsB(Surface=srf, UDivisions=U, VDivisions=V)
mesh_uv = MeshSurface(Surface=trib, UCount=Slider(1, range=0..10), VCount=Slider(1, range=0..10), Overhang=True, Equalize=False)
mesh = Mesh(mesh_uv)
medges = MeshEdges(Mesh=mesh)  # -> NakedEdges, InteriorEdges, NonManifoldEdges
line = Line(medges.NakedEdges)
join = JoinCurves(Curves=line, Preserve=False)  # -> flatten(Curves)
wbloop = WeaverbirdsLoopSubdivision(MeshCurves=join, Level=Slider(0, range=0..100), SmoothNakedEdges=1)
mjoin = MeshJoin(Meshes=wbloop)
竹篾宽度 = ClusterInput()
竹篾垂直间距 = ClusterInput()
竹篾厚度 = ClusterInput()
六角孔竹编 = 六角孔竹编(mesh=mjoin, num=竹篾宽度, D=竹篾垂直间距, D_2=竹篾厚度)
O = ClusterOutput(六角孔竹编)

# ==== cluster 六角孔竹编
mesh = ClusterInput()
D = ClusterInput()
mesh_2 = Mesh(mesh)

# ---- group: 分解mesh,再分解面提取face中的顶点序号
demesh = DeconstructMesh(Mesh=mesh_2)  # -> Vertices, Faces, Colours, Normals
deface = DeconstructFace(Face=demesh.Faces)  # -> CornerA, CornerB, CornerC, CornerD

# ----
wboffset = WeaverbirdsOffsetMesh(MeshCurves=mesh_2, Distance=D, OffsetType=0)  # -> flatten(OutputMeshCurves)
demesh_2 = DeconstructMesh(Mesh=wboffset)  # -> Vertices, Faces, Colours, Normals
deface_2 = DeconstructFace(Face=demesh_2.Faces)  # -> CornerA, CornerB, CornerC, CornerD

# ---- group: 提取顶点
item = ListItem(List=demesh.Vertices, Index=deface.CornerA, Wrap=True)
item_2 = ListItem(List=demesh.Vertices, Index=deface.CornerB, Wrap=True)
item_3 = ListItem(List=demesh.Vertices, Index=deface.CornerC, Wrap=True)

# ----
item_4 = ListItem(List=demesh_2.Vertices, Index=deface_2.CornerA, Wrap=True)
item_5 = ListItem(List=demesh_2.Vertices, Index=deface_2.CornerB, Wrap=True)
item_6 = ListItem(List=demesh_2.Vertices, Index=deface_2.CornerC, Wrap=True)
ln = Line(StartPoint=item_4, EndPoint=item_6)
ln_2 = Line(StartPoint=item_4, EndPoint=item_5)
ln_3 = Line(StartPoint=item_5, EndPoint=item_6)

# ---- group: 画线
ln_4 = Line(StartPoint=item, EndPoint=item_2)
ln_5 = Line(StartPoint=item, EndPoint=item_3)
ln_6 = Line(StartPoint=item_2, EndPoint=item_3)
flip = FlipCurve(Curve=ln_5)  # -> Curve, Flag

# ----
num = ClusterInput()
flip_2 = FlipCurve(Curve=ln)  # -> Curve, Flag
weave = Weave(Pattern=[0, 1, 2], Stream0=graft(ln_2), Stream1=graft(flip_2.Curve), Stream2=graft(ln_3), NullGaps=False)
num_2 = Number(num)
weave_2 = Weave(Pattern=[0, 1, 2], Stream0=graft(ln_4), Stream1=graft(flip.Curve), Stream2=graft(ln_6), NullGaps=False)

# ---- group: 做中点辅助
number_slider = Slider(0.5, range=0..1)
eval = EvaluateCurve(Curve=reparameterize(weave_2), Parameter=number_slider)  # -> Point, Tangent, Angle

# ----
eval_2 = EvaluateCurve(Curve=reparameterize(weave), Parameter=number_slider)  # -> Point, Tangent, Angle
amp = Amplitude(Vector=eval.Tangent, Amplitude=num_2)
amp_2 = Amplitude(Vector=eval_2.Tangent, Amplitude=num_2)
number_slider_2 = Slider(2, range=0..10)

# ---- group: 生成侧面点
move = Move(Geometry=eval.Point, Motion=expr("-x", amp))  # -> Geometry, Transform
move_2 = Move(Geometry=eval.Point, Motion=amp)  # -> Geometry, Transform
move_3 = Move(Geometry=eval_2.Point, Motion=expr("-x", amp_2))  # -> Geometry, Transform
move_4 = Move(Geometry=eval_2.Point, Motion=amp_2)  # -> Geometry, Transform

# ----
shift = ShiftList(List=move_4.Geometry, Shift=number_slider_2, Wrap=True)
shift_2 = ShiftList(List=move_3.Geometry, Shift=number_slider_2, Wrap=True)
weave_3 = Weave(
    Pattern=[0, 1, 2, 3],
    Stream0=graft(move_2.Geometry),
    Stream1=graft(move.Geometry),
    Stream2=graft(shift),
    Stream3=graft(shift_2),
    NullGaps=False)  # -> simplify(Weave)

# ---- group: 生成mesh
quad = MeshQuad(CornerA=0, CornerB=1, CornerC=2, CornerD=3)
conmesh = ConstructMesh(Vertices=weave_3, Faces=quad)

# ----
wbjoin = WeaverbirdsJoinMeshesAndWeld(Mesh=flatten(conmesh), Weld=False)
D_2 = ClusterInput()
wbloop = WeaverbirdsLoopSubdivision(MeshCurves=wbjoin, Level=Slider(2, range=0..10), SmoothNakedEdges=1)
wbthicken = WeaverbirdsMeshThicken(MeshCurves=wbloop, Distance=D_2, OffsetType=0)
O = ClusterOutput(wbthicken)
