# Grasshopper definition 切片算法.gh (Grasshopper 1.0.7)

geo = Geometry(<brep referenced from the Rhino model>)
切片对象 = Geometry(geo)
切片数量 = Number(Slider(30, range=0..100))
切片间隙 = Number(Slider(1, range=0..10))
getheight = CSharpScript(B=切片对象, num=切片数量)  # -> bf; inputs B: Brep, num: Int32
# ---------- getheight: C# usings ----------
using Rhino.Geometry.Intersect;
# ---------- getheight: C# ----------
    BoundingBox bbx = new BoundingBox();
    bbx = B.GetBoundingBox(true);     // get boundinbox
    Brep b = bbx.ToBrep();             //  Convert boundingbox into Brep
    Point3d[] p = b.DuplicateVertices(); // convert vertices into points
    Line l = new Line(p[0], p[4]);
    double height = l.Length / num;   //Get the height and divide it
    BrepFace BFbottomFace = b.Faces[4];  //Get the bottom of the boundingbox
    Brep bottomFace = BFbottomFace.ToBrep(); // Convert BrepFace into Brep

    double h = height;
    List<Brep> bottomFaces = new List<Brep>();
    for (int i = 0; i < num - 1;i++)
    {
      bottomFace.Translate(new Vector3d(0, 0, 1) * height);
      bottomFaces.Add(bottomFace);
      height = height + h;
    }
    //duplicate and move bottom


    Curve[] intCrv;
    Curve[] good = new Curve[0];
    Point3d[] intPts;
    for (int n = 0; n < num - 1 ;n++)
    {
      Intersection.BrepBrep(B, bottomFaces[n], 0.01, out intCrv, out intPts);
      var z = new int[intCrv.Length + good.Length];
      intCrv.CopyTo(z, 0);
      intCrv.CopyTo(z, intCrv.Length);
    } // get intersect curves (contour curves)
    
    bf= Brep.CreatePlanarBreps(z, 0.01);  //boundary surface
# ---------- end getheight ----------
c_script = CSharpScript(devia=切片间隙)  # -> A; inputs L: Double, devia: Double
# ---------- c_script: C# ----------
    if (L - devia <= 0)
    {A = 0;}
    else
    {A = L - devia;} // keep the thickness no less than zero
# ---------- end c_script ----------
c_script_2 = CSharpScript(brep=切片对象)  # -> A; inputs brep: Brep, F: Brep, a: Double
# ---------- c_script_2: C# ----------
    F.Translate(new Vector3d(0, 0, 1) * a);   //duplicate and move bottom

    Curve[] intersectionCurves;
    Point3d[] intersectionPoints;
    Intersection.BrepBrep(brep, F, 0.01, out intersectionCurves, out intersectionPoints); // get intersect curves (contour curves)
    A = Brep.CreatePlanarBreps(intersectionCurves, 0.01);
# ---------- end c_script_2 ----------
brep = Brep(<brep referenced from the Rhino model>)
Z = UnitZ(Factor=c_script)
c_script_3 = CSharpScript(x=brep, y=c_script)  # -> out, A; inputs x: Brep, y: Double
# ---------- c_script_3: C# ----------
    x.Translate(y * new Vector3d(0, 0, 1));
    A = x;
# ---------- end c_script_3 ----------
c_script_4 = CSharpScript()  # -> Out, A
间隙 = Slider(2, range=0..10)
geo_2 = Geometry(<brep referenced from the Rhino model>)
extr = Extrude(Base=c_script_3.A, Direction=Z)
contour = Contour(Shape=geo_2, Point=Point(0, 0, 0), Direction=Vector(0, 0, 1))
subtraction = Subtraction(A=Slider(5, range=0..100), B=间隙)
boundary = BoundarySurfaces(Edges=contour)
Z_2 = UnitZ(Factor=subtraction)
extr_2 = Extrude(Base=boundary, Direction=Z_2)
