# Grasshopper definition 图片生长纹.gh (Grasshopper 1.0.7)
# plug-ins: Kangaroo2 Components, Anemone

trigger = Trigger(Interval=100, TimerInterval=100, Target=number_slider_2)  # disabled
number_slider = Slider(666, range=0..1000)  # disabled
number_slider_2 = Slider(0.1, range=0..0.1)  # disabled
number_slider_3 = Slider(50, range=0..100)
multiplication = Multiplication(A=number_slider_3, B=Slider(0.5, range=0..1))
curve = Curve(<curve referenced from the Rhino model>)  # disabled
number_slider_4 = Slider(0.2, range=0..1)  # disabled
number_slider_5 = Slider(0.5, range=0..1)  # disabled
number_slider_6 = Slider(0.1, range=0..0.1)  # disabled
number_slider_7 = Slider(0.01, range=0..0.01)  # disabled
number_slider_8 = Slider(0.1, range=0..1)  # disabled
number_slider_9 = Slider(2000, range=0..10000)  # disabled
rectangle = Rectangle(Plane=PlaneXY(0, 0, 0), XSize=multiplication, YSize=multiplication, Radius=0)  # -> Rectangle, Length
trigger_2 = Trigger(Interval=-1000, TimerInterval=1000)  # disabled
trigger_3 = Trigger(Interval=-1000, TimerInterval=1000)  # disabled
trigger_4 = Trigger(Interval=-1000, TimerInterval=1000)  # disabled
trigger_5 = Trigger(Interval=-1000, TimerInterval=1000)  # disabled
trigger_6 = Trigger(Interval=-1000, TimerInterval=1000)  # disabled
curve_2 = Curve(graft(<curve referenced from the Rhino model>))  # disabled
geometry = Geometry([<curve referenced from the Rhino model> x4])
data_recorder = DataRecorder(number_slider_2, DataLimit=-10, RecordData=True)  # disabled
divide_curve = DivideCurve(Curve=curve, Count=number_slider, Kinks=False)  # -> Points, Tangents, Parameters; disabled
divide_curve_2 = DivideCurve(Curve=curve, Count=number_slider, Kinks=False)  # -> Points, Tangents, Parameters; disabled
square = Square(Plane=PlaneXY(0, 0, 0), Size=Slider(1, range=0..1), ExtentX=number_slider_3, ExtentY=number_slider_3)  # -> Cells, Points
curve_3 = Curve(<curve referenced from the Rhino model>)  # disabled
divide_curve_3 = DivideCurve(Curve=curve_2, Count=10, Kinks=False)  # -> simplify(Points), Tangents, Parameters
number_slider_10 = Slider(30, range=0..100)  # disabled
construct_domain = ConstructDomain(DomainStart=number_slider_7, DomainEnd=number_slider_6)  # disabled
construct_domain_2 = ConstructDomain(DomainStart=number_slider_8, DomainEnd=number_slider_5)  # disabled
region_union = RegionUnion(Curves=geometry)
polyline = PolyLine(Vertices=divide_curve.Points, Closed=True)  # disabled
construct_point = ConstructPoint(XCoordinate=0, YCoordinate=0, ZCoordinate=0)
mass_addition = MassAddition(Input=data_recorder)  # -> Result, PartialResults; disabled
area = Area(Geometry=rectangle.Rectangle)  # -> Area, Centroid
group = Group(Objects=flatten(square.Cells))
number_slider_11 = Slider(10, range=0..1000)
graph_mapper = GraphMapper(
    number_slider_4,
    x0=0,
    x1=1,
    y0=0,
    y1=1,
    container_name="Bezier",
    cpx=[0, 0.8939393759, 1, 1],
    cpy=[0, 0, 0.07048457861, 1])  # disabled
polyline_2 = PolyLine(Vertices=divide_curve_3.Points, Closed=False)
boundary_surfaces = BoundarySurfaces(Edges=curve_3)  # disabled
explode = Explode(Curve=polyline, Recursive=True)  # -> Segments, Vertices; disabled
construct_domain_3 = ConstructDomain(DomainStart=0, DomainEnd=number_slider_10)  # disabled
number_slider_12 = Slider(3, range=0..10)  # disabled
end_points = EndPoints(Curve=curve_2)  # -> Start, End; disabled
geometry_2 = Geometry(region_union)
addition = Addition(A=mass_addition.Result, B=1)  # disabled
remap_numbers = RemapNumbers(Value=number_slider_4, Source=Domain(0, 1), Target=construct_domain)  # -> Mapped, Clipped; disabled
oncurve = OnCurve(Points=divide_curve_3.Points, Curve=simplify(curve_2), Strength=1)  # disabled
vector_2pt = Vector2Pt(PointA=area.Centroid, PointB=construct_point, Unitize=False)  # -> Vector, Length
move = Move(Geometry=rectangle.Rectangle, Motion=vector_2pt.Vector)  # -> Geometry, Transform
curve_4 = Curve(move.Geometry)
closed = Closed(Curve=curve_4)  # -> Closed, Periodic
construct_domain_4 = ConstructDomain(DomainStart=0.05, DomainEnd=1)  # disabled
remap_numbers_2 = RemapNumbers(Value=number_slider_4, Source=Domain(0, 1), Target=construct_domain_2)  # -> Mapped, Clipped; disabled
construct_point_2 = ConstructPoint(XCoordinate=0, YCoordinate=0, ZCoordinate=0)
number_slider_13 = Slider(0.45, range=0..1)  # disabled
box = Box(group)
explode_2 = Explode(Curve=polyline_2, Recursive=True)  # -> Segments, Vertices
number_slider_14 = Slider(10, range=0..10)  # disabled
number_slider_15 = Slider(11, range=0..100)  # disabled
remap_numbers_3 = RemapNumbers(Value=graph_mapper, Source=Domain(0, 1), Target=construct_domain_3)  # -> Mapped, Clipped; disabled
number_slider_16 = Slider(1, range=0..10)  # disabled
line = Line(explode.Segments)  # disabled
length = Length(Curve=line)  # disabled
average = Average(Input=length)  # disabled
divide_curve_4 = DivideCurve(Curve=curve_4, Count=Slider(10, range=0..100), Kinks=False)  # -> Points, Tangents, Parameters
number_slider_17 = Slider(3.801, range=0..10)  # disabled
anchor = Anchor(Point=[end_points.Start, end_points.End], Strength=10000)
number_slider_18 = Slider(0.1, range=0..1)  # disabled
volume = Volume(Geometry=box)  # -> Volume, Centroid
construct_domain_5 = ConstructDomain(DomainStart=1, DomainEnd=number_slider_12)  # disabled
number_slider_19 = Slider(2, range=0..11)  # disabled
line_2 = Line(simplify(explode_2.Segments))  # disabled
remap_numbers_4 = RemapNumbers(Value=graph_mapper, Source=construct_domain_4, Target=construct_domain_5)  # -> Mapped, Clipped; disabled
button = Button()  # disabled
cull_index = CullIndex(List=explode.Vertices, Indices=-1, Wrap=True)  # disabled
geometry_3 = Geometry(<brep referenced from the Rhino model>)  # disabled
vector_2pt_2 = Vector2Pt(PointA=volume.Centroid, PointB=construct_point_2, Unitize=False)  # -> Vector, Length
fillet = Fillet(Curve=geometry_2, Radius=Slider(0.461, range=0..10))
panel = Panel("1")  # disabled
number_slider_20 = Slider(0.1, range=0..0.1)  # disabled
panel_2 = Panel("0")  # disabled
number_slider_21 = Slider(5, range=0..10)  # disabled
length_2 = Length(Curve=line_2)  # disabled
number_slider_22 = Slider(2, range=0.01..3)  # disabled
panel_3 = Panel("0")  # disabled
equallength = EqualLength(Line=line_2, Strength=1)  # -> simplify(Equal); disabled
multiplication_2 = Multiplication(A=average, B=number_slider_13)  # disabled
polyline_3 = PolyLine(Vertices=divide_curve_4.Points, Closed=closed.Closed)
triremesh = TriRemesh(Geometry=geometry_3, Length=number_slider_14, Iterations=25)  # -> Triangulation, Dual, Creases; disabled
move_2 = Move(Geometry=square.Cells, Motion=vector_2pt_2.Vector)  # -> Geometry, Transform
number_slider_23 = Slider(11, range=0..100)  # disabled
mesh_surface = MeshSurface(Surface=boundary_surfaces, UCount=number_slider_15, VCount=number_slider_15, Overhang=True, Equalize=False)  # disabled
number_slider_24 = Slider(470, range=0..1000)  # disabled
number_slider_25 = Slider(0.001, range=0..0.01)  # disabled
multiplication_3 = Multiplication(A=multiplication_2, B=addition)  # disabled
entwine = Entwine(Branch00=equallength, Branch01=oncurve, Branch02=anchor, FlattenInputs=True)  # -> flatten(Result); disabled
spherecollide = SphereCollide(Points=cull_index, Radius=multiplication_3, Strength=number_slider_19)  # disabled
group_2 = Group(Objects=flatten(move_2.Geometry))
boolean_toggle = BooleanToggle(True)  # disabled
button_2 = Button()  # disabled
explode_3 = Explode(Curve=polyline_3, Recursive=True)  # -> Segments, Vertices
length_3 = Length(Curve=explode_3.Segments)
number_slider_26 = Slider(50, range=0..100)  # disabled
area_2 = Area(Geometry=move_2.Geometry)  # -> Area, flatten(Centroid)
length_line = LengthLine(Line=line, Strength=number_slider_22)  # disabled
shift_list = ShiftList(List=line, Shift=1, Wrap=True)  # disabled
anchorxyz = AnchorXYZ(Point=cull_index, X=False, Y=False, Z=True, Strength=1000)  # disabled
box_2 = Box(group_2)
deconstruct_brep = DeconstructBrep(Brep=box_2)  # -> Faces, Edges, Vertices
geometry_4 = Geometry(deconstruct_brep.Faces)
triremesh_2 = TriRemesh(Geometry=geometry_4, Iterations=25)  # -> Triangulation, Dual, Creases
zombiesolver = ZombieSolver(GoalObjects=entwine, Threshold=1e-10, Tolerance=number_slider_25, MaxIterations=number_slider_24)  # -> I, simplify(V), O; disabled
solver = Solver(GoalObjects=entwine, Reset=button_2, Threshold=1e-15, Tolerance=0.0001, On=boolean_toggle)  # -> I, simplify(V), O; disabled
number_slider_27 = Slider(60, range=0..222)  # disabled
bounds = Bounds(Numbers=length_3)
line_3 = Line(explode_3.Segments)
onmesh = OnMesh(Points=cull_index, Mesh=triremesh.Triangulation, Strength=number_slider_26)  # disabled
clampangle = ClampAngle(UpperLimit=1.570796327, LowerLimit=0.7853981634, Strength=1)  # disabled
boolean_toggle_2 = BooleanToggle(True)  # disabled
循环头部 = 循环头部(重复=Slider(35, range=0..35), 触发器=Button(), 数据=line_3, D1=triremesh_2.Triangulation, D2=area_2.Centroid)  # -> port, 计数器, 数据, 数据_2, 数据_3, 数据_4
geometry_5 = Geometry(zombiesolver.V)  # disabled
button_3 = Button()  # disabled
plasticanchor = PlasticAnchor(Point=cull_index, Limit=1, Strength=number_slider_17, Reset=button_3)  # disabled
unflatten_tree = UnflattenTree(Tree=solver.V, Guide=divide_curve_3.Points)
unflatten_tree_2 = UnflattenTree(Tree=zombiesolver.V, Guide=divide_curve_3.Points)  # disabled
number_slider_28 = Slider(20, range=0..100)  # disabled
radians = Radians(Degrees=number_slider_27)  # disabled
equalangle = EqualAngle(LineA=graft(line), LineB=graft(shift_list), Strength=1)  # disabled
panel_4 = Panel(bounds)
number_slider_29 = Slider(1e-05, range=0..0.001)  # disabled
image_sampler = ImageSampler(循环头部.数据_3, Filter="Value", Interpolate=False, Umax=50, Umin=0, Vmax=50, Vmin=0, Wrap=1)
polyline_4 = PolyLine(Vertices=unflatten_tree, Closed=False)
boolean_toggle_3 = BooleanToggle(True)  # disabled
number_slider_30 = Slider(0.0001, range=0..0.0001)  # disabled
polyline_5 = PolyLine(Vertices=unflatten_tree_2, Closed=False)
line_4 = Line(循环头部.数据)
anglesnap = AngleSnap(LineA=simplify(graft(line)), LineB=simplify(graft(shift_list)), Factor=radians, Strength=1)  # disabled
curve_middle = CurveMiddle(Curve=line_4)  # -> graft(Midpoint)
panel_5 = Panel(循环头部.计数器)
geometry_6 = Geometry(循环头部.数据_3)
explode_4 = Explode(Curve=polyline_5, Recursive=True)  # -> Segments, Vertices
explode_5 = Explode(Curve=polyline_4, Recursive=True)  # -> Segments, Vertices
entwine_2 = Entwine(
    Branch00=length_line,
    Branch01=spherecollide,
    Branch02=onmesh,
    Branch03=equalangle,
    Branch04=plasticanchor,
    Branch05=anchorxyz,
    FlattenInputs=True)  # disabled
solver_2 = Solver(GoalObjects=entwine_2, Reset=button_3, Threshold=1e-15, Tolerance=0.0001, On=boolean_toggle_2)  # -> I, V, O; disabled
bounds_2 = Bounds(Numbers=image_sampler)
length_4 = Length(Curve=line_4)
tree_branch = TreeBranch(Tree=simplify(solver_2.O), Path="{0}", MaintainPaths=True)  # disabled
find_similar_member = FindSimilarMember(Data=curve_middle, Set=循环头部.数据_3)  # -> Hit, simplify(Index)
circle = Circle(Plane=solver_2.V, Radius=multiplication_3)  # disabled
line_5 = Line(explode_4.Segments)
angle = Angle(Strength=1)  # disabled
line_6 = Line(explode_5.Segments)
line_7 = Line(tree_branch)  # disabled
remap_numbers_5 = RemapNumbers(Value=image_sampler, Source=bounds_2, Target=Domain(0, 1))  # -> Mapped, Clipped
length_5 = Length(Curve=line_5)
length_6 = Length(Curve=line_6)
graph_mapper_2 = GraphMapper(
    remap_numbers_5.Mapped,
    x0=0,
    x1=1,
    y0=0,
    y1=1,
    container_name="Bezier",
    cpx=[0, 0.4347825944, 0.6231883764, 1],
    cpy=[0, 0.3913043737, 0.6159420013, 1])
panel_6 = Panel(length_5)
panel_7 = Panel(length_6)
expression = Expression(x=Slider(2, range=0..10), y=Slider(0.66, range=0..1), z=graph_mapper_2, Expression="(X-Y)*Z+Y")
list_item = ListItem(List=expression, Index=find_similar_member.Index, Wrap=True)  # -> flatten(Item)
larger_than = LargerThan(FirstNumber=length_4, SecondNumber=list_item)  # -> LargerThan, OrEqualTo
dispatch = Dispatch(List=simplify(line_4), DispatchPattern=larger_than.OrEqualTo)  # -> ListA, ListB
dispatch_2 = Dispatch(List=list_item, DispatchPattern=larger_than.OrEqualTo)  # -> ListA, ListB
shatter = Shatter(Curve=reparameterize(dispatch.ListA), Parameters=Slider(0.5, range=0..1))
duplicate_data = DuplicateData(Data=dispatch_2.ListA, Number="2", Order=False)
merge = Merge(Data1=flatten(shatter), Data2=flatten(dispatch.ListB))
line_8 = Line(merge)
end_points_2 = EndPoints(Curve=merge)  # -> Start, End
merge_2 = Merge(Data1=flatten(duplicate_data), Data2=flatten(dispatch_2.ListB))
number_slider_31 = Slider(1, range=0..1)
onmesh_2 = OnMesh(Points=end_points_2.Start, Mesh=循环头部.数据_2, Strength=Slider(100, range=0..100))
length_line_2 = LengthLine(Line=merge, Strength=Slider(1, range=0..1))
collider = Collider(Objects=line_8, Radii=merge_2, Strength=Slider(2, range=0..10))
number_slider_32 = Slider(0.001, range=0..0.001)
number_slider_33 = Slider(0.1, range=0..0.1)
entwine_3 = Entwine(Branch00=collider, Branch01=length_line_2, Branch02=onmesh_2, FlattenInputs=True)
panel_8 = Panel("""0
-1""")
zombiesolver_2 = ZombieSolver(GoalObjects=entwine_3, Threshold=Slider(0.01, range=0..0.01), Tolerance=0.0001, MaxIterations=Slider(10, range=0..100))  # -> I, V, O
panel_9 = Panel(zombiesolver_2.O)
cull_index_2 = CullIndex(List=zombiesolver_2.O, Indices=panel_8, Wrap=True)  # -> flatten(List)
循环尾部 = 循环尾部(
    port=循环头部.port,
    结束=False,
    数据=cull_index_2,
    数据_2=循环头部.数据_2,
    数据_3=循环头部.数据_3,
    数据_4=循环头部.数据_4,
    TimeOutVal=0,
    pausedState=False,
    state="输出常数")  # -> 数据, D1, D2, D3
panel_10 = Panel(cull_index_2)
line_9 = Line(循环尾部.数据)
data_dam = DataDam(DataDataA=line_9, BufferDelay=10000000, BufferMode=0)
geometry_7 = Geometry(data_dam)  # disabled
geometry_8 = Geometry(geometry_7)  # disabled
join_curves = JoinCurves(Curves=geometry_8, Preserve=False)  # disabled
closed_2 = Closed(Curve=join_curves)  # -> Closed, Periodic; disabled
divide_curve_5 = DivideCurve(Curve=join_curves, Count=number_slider_9, Kinks=False)  # -> Points, Tangents, Parameters; disabled
polyline_6 = PolyLine(Vertices=divide_curve_5.Points, Closed=closed_2.Closed)  # disabled
explode_6 = Explode(Curve=polyline_6, Recursive=True)  # -> Segments, Vertices; disabled
line_10 = Line(explode_6.Segments)  # disabled
show = Show(G=polyline_6)  # disabled
rod = Rod(
    Polyline=polyline_6,
    LengthFactor=remap_numbers_4.Mapped,
    AngleFactor=panel_2,
    AxialStrength=panel,
    BendStrength=remap_numbers_3.Mapped)  # disabled
cull_index_3 = CullIndex(List=explode_6.Vertices, Indices=panel_3, Wrap=True)  # disabled
list_length = ListLength(List=cull_index_3)  # disabled
collider_2 = Collider(Objects=[line_10, cull_index_3], Radii=remap_numbers_2.Mapped, Strength=number_slider_21)  # disabled
onmesh_3 = OnMesh(Points=cull_index_3, Mesh=mesh_surface, Strength=number_slider_23)  # disabled
plasticanchor_2 = PlasticAnchor(Point=cull_index_3, Limit=number_slider_18, Strength=remap_numbers.Mapped, Reset=button)  # disabled
entwine_4 = Entwine(Branch00=show, Branch01=rod, Branch02=onmesh_3, Branch03=plasticanchor_2, Branch04=collider_2, FlattenInputs=True)  # disabled
solver_3 = Solver(GoalObjects=entwine_4, Reset=button, Threshold=number_slider_29, Tolerance=0.0001, On=boolean_toggle_3)  # -> I, V, O; disabled
stepsolver = StepSolver(
    GoalObjects=entwine_4,
    Tolerance=number_slider_30,
    Momentum=True,
    Damping=0.99,
    SubIterations=number_slider_28,
    Animate=boolean_toggle_3)  # -> I, V, O; disabled
list_item_2 = ListItem(List=flatten([solver_3.O, stepsolver.O]), Index=0, Wrap=True)  # disabled
control_polygon = ControlPolygon(Curve=list_item_2)  # -> Polygon, Points; disabled
cull_index_4 = CullIndex(List=control_polygon.Points, Indices=0, Wrap=True)  # disabled
interpolate = Interpolate(Vertices=cull_index_4, Degree=3, Periodic=True, KnotStyle=1)  # -> Curve, Length, Domain; disabled
