# Grasshopper definition 希尔伯特曲线.gh (Grasshopper 1.0.7)

阶数 = Number(Slider(5, range=0..10))
倒角 = Number(Slider(0.8, range=0..1))
曲线阶数 = Number(Slider(1, range=0..10))
半径 = Number(Slider(0.4, range=0..1))
hilbert_curve = CSharpScript(n=阶数)  # -> out, A, B; inputs n: Int32
# ---------- hilbert_curve: C# ----------
    List<Point3d> ptlist = new List<Point3d> ();
    for (int i = 0; i < System.Math.Pow(4, n) ;i++)
    {
      ptlist.Add(hindex2xy(i, n));
    }
    A = ptlist;
    B = Hilbertlength(n);
# ---------- hilbert_curve: C# additional code ----------
  int last2bits(int x) { return (x & 3); }  //用来求出最后两位。二进制运算按位与，只有都有1才是1，3的二进制是11

  double Hilbertlength(int n)
  {double l = System.Math.Pow(2, 2 * n) - 1;
    return l;
  }


  Point3d p1 = new Point3d(0, 0, 0);
  Point3d p2 = new Point3d(0, 1, 0);
  Point3d p3 = new Point3d(1, 1, 0);
  Point3d p4 = new Point3d(1, 0, 0); //一阶时候的四个点坐标

  Point3d hindex2xy(int index, int n) {

    List < Point3d > ptlist = new List<Point3d>(){p1, p2, p3, p4};

    Point3d tmpPt = ptlist[last2bits(index)];  // 求对应一阶的哪个点
    index = (index >> 2);   // 位运算右移2位，相当于去掉后两位

    var x = tmpPt.X;
    var y = tmpPt.Y;

    for (int i = 2; i <= n ; i++) {
      double tmp;
      double distance = System.Math.Pow(2, i - 1); //每过一阶需要变化的距离

      switch (last2bits(index)) {    //再次求对应一阶的哪个点，并分类讨论得到坐标值
        case 0:                           //对应左下角的点，因为有旋转，x,y交换位置
          tmp = x;x = y;y = tmp;
          break;

        case 1:                        //对应左上角的点，x不变，y增大
          y = y + distance;
          break;

        case 2:                           //对应右上角的点，x,y都增大
          x = x + distance;
          y = y + distance;
          break;

        case 3:
          tmp = y;
          y = distance - x - 1;
          x = 2 * distance - tmp - 1;
          break;
      }

      index = (index >> 2); // 位运算右移2位，相当于去掉后两位
    }

    Point3d Pnew = new Point3d(x, y, 0);
    return Pnew;
  }
# ---------- end hilbert_curve ----------
nurbs = NurbsCurve(Vertices=hilbert_curve.A, Degree=曲线阶数, Periodic=False)  # -> Curve, Length, Domain
总长度 = Number(hilbert_curve.B)
fillet = Fillet(Curve=nurbs.Curve, Radius=倒角)
panel = Panel(总长度)
pipe = Pipe(Curve=fillet, Radius=半径, Caps=0)
preview = CustomPreview(
    Geometry=pipe,
    Material={diffuse=RGB(0, 0, 0), emission=RGB(0, 0, 0), shine=0.5274194479, specular=RGB(118, 118, 118), transparency=0})
