# Grasshopper definition 批量导出stl.gh (Grasshopper 1.0.7)
# plug-ins: Pancake

truebutton = TrueOnlyButton()
truebutton_2 = TrueOnlyButton()
panel = Panel("0.1")
物件 = Geometry(<brep referenced from the Rhino model>)
now = CSharpScript()  # -> A; same code as now

# ---- group: 自定义文件名格式
join = TextJoin(Text=["C:\Users\admin\Desktop\3Dprinting\", now, ".{0}.stl"])

# ----
geo = Geometry(<curve referenced from the Rhino model>)
truebutton_3 = TrueOnlyButton()
mesh = Mesh(<mesh referenced from the Rhino model>)
批量导出stl精简版 = 批量导出stl精简版(mesh=mesh, 导出=truebutton_2, 重置=Button())
导出dxf = 导出dxf(geo=geo, 导出=truebutton, 重置=Button())
批量导出stl = 批量导出stl(物件=物件, 文件名样式=join, 导出=truebutton_3, 重置=Button())
panel_2 = Panel(导出dxf)
panel_3 = Panel(批量导出stl精简版)
panel_4 = Panel(批量导出stl)

# ==== cluster 批量导出stl
物件 = ClusterInput()
导出 = ClusterInput()
重置 = ClusterInput()
文件名样式 = ClusterInput()
导出_2 = Boolean(导出)
重置_2 = Boolean(重置)
物件_2 = Mesh(物件)
lng = ListLength(List=物件_2)
pcfileseries = FilepathSeries(
    PatternOfFilepath=文件名样式,
    StartingIndex=1,
    QuantityOfFilenames=lng,
    GenerateNext=导出_2,
    Reset=重置_2,
    LastSaveLocalization="neutral,N")  # -> Filepath, ListOfFilepath, CounterOfFirstFile
pcexportstl = ExportSTL(
    Mesh=物件_2,
    Relocate=True,
    SavePath=pcfileseries.ListOfFilepath,
    SaveAsBinaryFile=True,
    SaveNow=导出_2,
    LastSaveLocalization="neutral,N")
ok = ClusterOutput(pcexportstl)

# ==== cluster 导出dxf
now = CSharpScript()  # -> A
# ---------- now: C# ----------
    DateTime now = DateTime.Now;
    A = now.Year + "-" + now.Month + "-" + now.Day + "-" + now.Hour+"h";
# ---------- end now ----------

# ---- group: 自定义文件名格式
join = TextJoin(Text=["C:\Users\admin\Desktop\dxf\", now, ".{0}.dxf"])

# ----
重置 = ClusterInput()
导出 = ClusterInput()
重置_2 = Boolean(重置)
导出_2 = Boolean(导出)
pcecdxf = DXFExportOption(Scheme="Default", LastSaveLocalization="neutral,N")
pcfileseries = FilepathSeries(
    PatternOfFilepath=join,
    StartingIndex=1,
    QuantityOfFilenames=-1,
    GenerateNext=导出_2,
    Reset=重置_2,
    LastSaveLocalization="neutral,N")  # -> Filepath, ListOfFilepath, CounterOfFirstFile
geo = ClusterInput()
pcexportas = ExportAs(
    Geometry=geo,
    FileLocation=pcfileseries.ListOfFilepath,
    Overwrite=True,
    Options=pcecdxf,
    Export=导出_2,
    CompMode=False,
    LastSaveLocalization="neutral,N")  # -> OK, ExportCommand
ok = ClusterOutput(pcexportas.OK)

# ==== cluster 批量导出stl精简版
导出 = ClusterInput()
重置 = ClusterInput()
mesh = ClusterInput()
now = CSharpScript()  # -> A; same code as now

# ---- group: 自定义文件名格式
join = TextJoin(Text=["C:\Users\admin\Desktop\3Dprinting\", now, ".{0}.stl"])

# ----
导出_2 = Boolean(导出)
重置_2 = Boolean(重置)
mesh_2 = Mesh(mesh)
lng = ListLength(List=mesh_2)
pcfileseries = FilepathSeries(
    PatternOfFilepath=join,
    StartingIndex=1,
    QuantityOfFilenames=lng,
    GenerateNext=导出_2,
    Reset=重置_2,
    LastSaveLocalization="neutral,N")  # -> Filepath, ListOfFilepath, CounterOfFirstFile
pcexportstl = ExportSTL(
    Mesh=mesh_2,
    Relocate=True,
    SavePath=pcfileseries.ListOfFilepath,
    SaveAsBinaryFile=True,
    SaveNow=导出_2,
    LastSaveLocalization="neutral,N")
ok = ClusterOutput(pcexportstl)
