# Grasshopper definition 根据颜色六边形镂空.gh (Grasshopper 1.0.7)
# plug-ins: Kangaroo2 Components, Weaverbird

num = Number()
crv = Curve()
mesh = Mesh(<mesh referenced from the Rhino model>)
dom = ConstructDomain(DomainStart=Slider(1, range=0..10), DomainEnd=Slider(4, range=0..100))
medges = MeshEdges(Mesh=mesh)  # -> NakedEdges, InteriorEdges, NonManifoldEdges
join = JoinCurves(Curves=medges.NakedEdges, Preserve=False)
explode = Explode(Curve=join, Recursive=True)  # -> Segments, Vertices
remeshbycolour = RemeshByColour(Mesh=mesh, LengthInterval=dom, FixVertices=explode.Vertices, Flip=1, Iterations=Slider(25, range=0..100), Reset=Button())
wbdual = WeaverbirdsDualGraph(MeshCurves=remeshbycolour, DualMode=1)

explode_2 = Explode(Curve=wbdual, Recursive=True)  # -> Segments, Vertices
len = Length(Curve=wbdual)
duppt = RemoveDuplicatePts(Points=explode_2.Vertices, Tolerance=0.01)
bnd = Bounds(Numbers=len)
dom_2 = ConstructDomain(DomainStart=Slider(0.8, range=0..1), DomainEnd=Slider(0.7, range=0..1))
avr = Average(Input=duppt)
remap = RemapNumbers(Value=len, Source=bnd, Target=dom_2)  # -> Mapped, Clipped
graft = GraftTree(Tree=wbdual, IncludeEmptyLists=True, IncludeNullItems=True)  # -> simplify(Tree)
scale = Scale(Geometry=graft(wbdual), Center=avr, Factor=graft(remap.Mapped))  # -> simplify(Geometry), Transform

loft = Loft(
    Curves=[graft, scale.Geometry],
    Options={Adjust=False, Closed=False, LoftEnds=0, LoftSimp=0, LoftType=0, Rebuild=10, Refit=0.01})
smesh = SimpleMesh(Brep=loft)  # -> flatten(Mesh)
厚度 = Slider(2, range=0..10)
mjoin = MeshJoin(Meshes=smesh)
colour = ColourPicker(PickedColour=RGB(140, 140, 140))
flipall = FlipAll(M=mjoin)
offsetmesh = CSharpScript(M=flipall, dis=厚度)  # -> A; inputs M: Mesh, dis: Double
# ---------- offsetmesh: C# ----------
    A = M.Offset(dis, true);
# ---------- end offsetmesh ----------
preview = CustomPreview(Geometry=offsetmesh, Material=colour)

# ==== cluster FlipAll
toggle = BooleanToggle(True)
M = ClusterInput()
flipm = FlipMesh(Mesh=M, VertexNormals=toggle, FaceNormals=toggle, FaceOrientation=toggle)
R = ClusterOutput(flipm)
