# Grasshopper definition 超椭圆.gh (Grasshopper 1.0.7)

半径 = Slider(25.6, range=0..100)
精细程度 = Slider(1000, range=0..1000)
次方数 = Slider(3, range=0..10)
超椭圆 = 超椭圆_2(I=Slider(2.8, range=0..10), num=Slider(10, range=0..10), num_2=Slider(9, range=0..10))
超椭圆_2 = 超椭圆(F=半径, num=精细程度, y=次方数)
crv = Curve(超椭圆)
crv_2 = Curve(超椭圆_2)

# ==== cluster 超椭圆
y = ClusterInput()
F = ClusterInput()
num = ClusterInput()
num_2 = Number(num)
dom = ConstructDomain(DomainStart=expr("-x", Slider(0, range=0..100)), DomainEnd=Slider(1, range=0..100))
range = Range(Domain=dom, Steps=num_2)
eval = Evaluate(F="(1-abs(x)^y)^(1/y)", x=range, y=y)
pt = ConstructPoint(XCoordinate=range, YCoordinate=expr("-x", eval), ZCoordinate=0)  # -> reverse(flatten(Point))
pt_2 = ConstructPoint(XCoordinate=expr("-x", range), YCoordinate=eval, ZCoordinate=0)  # -> reverse(flatten(Point))
pt_3 = ConstructPoint(XCoordinate=expr("-x", range), YCoordinate=expr("-x", eval), ZCoordinate=0)  # -> flatten(Point)
pt_4 = ConstructPoint(XCoordinate=range, YCoordinate=eval, ZCoordinate=0)
split = SplitList(List=pt_4, Index=num_2)  # -> ListA, ListB
split_2 = SplitList(List=pt, Index=num_2)  # -> ListA, ListB
split_3 = SplitList(List=pt_3, Index=num_2)  # -> ListA, ListB
split_4 = SplitList(List=pt_2, Index=num_2)  # -> ListA, ListB
merge = Merge(Data1=split.ListA, Data2=split_2.ListA, Data3=split_3.ListA, Data4=split_4.ListA)  # -> flatten(Result)
intcrv = Interpolate(Vertices=merge, Degree=3, Periodic=True, KnotStyle=1)  # -> Curve, Length, Domain
scale = Scale(Geometry=intcrv.Curve, Center=Point(0, 0, 0), Factor=F)  # -> Geometry, Transform
G = ClusterOutput(scale.Geometry)

# ==== cluster 超椭圆_2
I = ClusterInput()
num = ClusterInput()
num_2 = ClusterInput()
num_3 = Number(num)
num_4 = Number(num_2)
dom = ConstructDomain(DomainStart=expr("-x", num_3), DomainEnd=num_3)
dom_2 = ConstructDomain(DomainStart=expr("-x", num_4), DomainEnd=num_4)
pt = Point(Point(0, 0, 0))
rectangle = Rectangle(Plane=pt, XSize=dom, YSize=dom_2, Radius=0)  # -> Rectangle, Length
explode = Explode(Curve=rectangle.Rectangle, Recursive=True)  # -> Segments, Vertices
shift = ShiftList(List=explode.Segments, Shift=-1, Wrap=True)
eval = EvaluateCurve(Curve=reparameterize(explode.Segments), Parameter=0.5)  # -> Point, Tangent, Angle
eval_2 = EvaluateCurve(Curve=reparameterize(shift), Parameter=0.5)  # -> Point, Tangent, Angle
weave = Weave(Pattern=[0, 1, 2], Stream0=eval.Point, Stream1=explode.Vertices, Stream2=eval_2.Point, NullGaps=False)
number_slider = Slider(3, range=0..10)
partition = PartitionList(List=weave, Size=number_slider)
panel = Panel("""1
1""")
knots = KnotVector(Count=number_slider, Degree=Slider(2, range=0..10), Periodic=False)
ins = InsertItems(List=panel, Item=I, Indices=1, Wrap=True)
nurbcrv = NurbsCurvePWK(Points=partition, Weights=ins, Knots=knots)  # -> Curve, Length, Domain
crv = Curve(flatten(nurbcrv.Curve))
join = JoinCurves(Curves=crv, Preserve=False)
C = ClusterOutput(join)
